# Grasshopper definition 180210 massing.gh (Grasshopper 1.0.4)

gnd_cut_msh = Mesh(<mesh referenced from the Rhino model>)
mass_mshs = Mesh([<mesh referenced from the Rhino model> x2])
c_script = CSharpScript(masses=mass_mshs, grndVoids=gnd_cut_msh, pad=Slider(0.25, range=0..0.25))  # -> out, cutBox, ground, dim, depth; inputs masses: list of Mesh, grndVoids: list of Mesh, pad: Double
# ---------- c_script: C# ----------
    List<Mesh> mshs = new List<Mesh>();
    mshs.AddRange(masses);
    mshs.AddRange(grndVoids);


    // Find center of mass
    //
    VolumeMassProperties vmp = null;
    foreach (Mesh msh in mshs){
      if (vmp == null) vmp = VolumeMassProperties.Compute(msh);
      else vmp.Sum(VolumeMassProperties.Compute(msh));
    }

    // Find best rotation in xy plane
    //
    int cnt = 360;
    Double bestRot = 0;
    Double bestVol = Double.MaxValue;
    for (int n = 0; n < cnt; n++){
      Double rot = Math.PI * n / cnt;
      BoundingBox ubx = new BoundingBox();
      foreach (Mesh msh in mshs){
        Transform xf = Transform.Rotation(rot, vmp.Centroid);
        BoundingBox bx = msh.GetBoundingBox(xf);
        ubx.Union(bx);
      }
      if (ubx.Volume < bestVol) {
        bestVol = ubx.Volume;
        bestRot = rot;
      }
    }

    Print(bestRot.ToString());
    
    // Construct base plane at center of mass in XY, at Z=0
    //
    Plane bPln = new Plane(vmp.Centroid, new Vector3d(0, 0, 1));
    bPln.Rotate(-bestRot, bPln.Normal);
    bPln.Translate(new Vector3d(0, 0, -bPln.Origin.Z));

    // Construct bounding intervals on plane
    //
    BoundingBox bBox = new BoundingBox();
    foreach (Mesh msh in mshs) bBox.Union(msh.GetBoundingBox(bPln));
    cutBox = bBox;
    
    /*
    Interval ival_x = new Interval(bBox.Min.X, bBox.Max.X);
    Interval ival_y = new Interval(bBox.Min.Y, bBox.Max.Y);
    Interval ival_z = new Interval(bBox.Min.Z, bBox.Max.Z);
    ival_z.Grow(-bPln.Origin.Z);

    Double maxDim = Math.Max(Math.Max(ival_x.Length, ival_y.Length), ival_z.Length);

    ival_x = scaleIval(ival_x, maxDim / ival_x.Length * (1 + pad));
    ival_y = scaleIval(ival_y, maxDim / ival_y.Length * (1 + pad));
    ival_z = scaleIval(ival_z, maxDim / ival_z.Length * (1 + pad), true);


    Box cBox = new Box(bPln, ival_x, ival_y, ival_z);
    cutBox = cBox;
    dim = cBox.Z.Length;
    depth = Math.Abs(cBox.Z.T0);

    Plane basePlane = new Plane(cBox.PointAt(0.5, 0.5, 0), bPln.XAxis, bPln.YAxis);
    basePlane.Translate(new Vector3d(0, 0, -Math.Abs(cBox.Z.T0)));

    Cylinder cyl = new Rhino.Geometry.Cylinder(
      new Circle(basePlane, Math.Sqrt(Math.Pow(ival_x.Length, 2) + Math.Pow(ival_y.Length, 2))),
      Math.Abs(cBox.Z.T0) * 2
      );

    Mesh mCyl = Mesh.CreateFromBrep(cyl.ToBrep(true, true), new MeshingParameters())[0];
    mCyl = Mesh.CreateFromCylinder(cyl, 30, 30);

    Mesh cutGround = Mesh.CreateBooleanDifference(new List<Mesh>(new Mesh[] {mCyl}), grndVoids)[0];

    ground = cutGround;
 
 */
# ---------- c_script: C# additional code ----------
  Interval scaleIval(Interval ival, Double fac, Boolean fixMin = false){
    Double delt = ival.Length * fac - ival.Length;
    if (fixMin) return new Interval(ival.T0, ival.T1 + delt);
    return new Interval(ival.T0 - delt / 2, ival.T1 + delt / 2);
  }
# ---------- end c_script ----------
box = Box(c_script.cutBox)
mesh = Mesh(c_script.ground)
panel = Panel(c_script.out)
mass_mshs_2 = Mesh(mass_mshs)
c_script_2 = CSharpScript(cutBox=c_script.cutBox)  # -> out, A; inputs cutBox: Box
# ---------- c_script_2: C# ----------
  


    A = cutBox.Plane;
# ---------- end c_script_2 ----------
