# Grasshopper definition 180301 isovist mapper.gh (Grasshopper 1.0.4)

pt = Point(Point(-6.066935918, 30.62990083, 0))
eye_height_in_meters = Panel("1.5")
brep = Brep(<brep referenced from the Rhino model>)
rec = Rectangle({Plane=PlaneXY(10.95081698, 26.22058418, 0), Size=Domain2(u=-57.99158887..57.99158887, v=-65.40813301..65.40813301)})
context = Brep(brep)
out_bnds = Curve(rec)
eye_height = Number(eye_height_in_meters)
out_bnds_2 = Curve(out_bnds)
context_2 = Brep(context)
Z = UnitZ(Factor=eye_height)
button = Button()

# ---- group: define ground
# DEFINE GROUND: The ground is defined at the lower edge of the bounding box of the given Breps. Ground box is sized to 1000 times the size of the bounding box. Maximum x-y dimension of bounding box is returned.
cluster = Cluster(bounds=out_bnds_2, breps=context_2)  # -> ground_2, max_dim_2

# ----
move = Move(Geometry=pt, Motion=Z)  # -> Geometry, Transform
sphere_radius_in_meters = Panel("1.0")
# CONSTANTS
# The following values should remain constant across a training set of all spatial types.
number_slider = Slider(0.25, range=0..0.333)
fixed_domain = Panel("0 to 25")
xy = XYPlane(Origin=move.Geometry)
sample_planes = Plane(xy)
px_width = Panel("80")
px_height = Panel("40")
merge = Merge(Data1=cluster.ground_2, Data2=context_2)
px_width_2 = Panel("60")
px_height_2 = Panel("30")
hit_domain = Domain(fixed_domain)
hit_domain_2 = Domain(hit_domain)
hit_domain_3 = Domain(hit_domain)
breps = Brep(merge)
breps_2 = Brep(breps)
pi = Pi(Factor=number_slider)
px_width_3 = Integer(px_width_2)
px_width_4 = Integer(px_width_3)
px_width_5 = Integer(px_width_3)
px_width_6 = Integer(px_width_3)
px_height_3 = Integer(px_height_2)
px_height_4 = Integer(px_height_3)
multiplication = Multiplication(A=px_width_4, B=px_height_4)
range = Range(Domain=Domain(0, 1), Steps=expr("x-1", multiplication))
dup = DuplicateData(Data=Slider(0.5, range=0..1), Number=multiplication, Order=True)
px_height_5 = Integer(px_height_3)
px_height_6 = Integer(px_height_3)
theta_crop = Number(pi)
theta_crop_2 = Number(theta_crop)
theta_crop_3 = Number(theta_crop)
c_script = CSharpScript(
    showPts=Toggle(True),
    pxWidth=px_width_5,
    pxHeight=px_height_5,
    samplePlanes=sample_planes,
    breps=breps_2,
    hitDomain=hit_domain_2,
    thetaCrop=theta_crop_2)  # -> out, hitCounts, hitPts, hitDists, hitNormDists, A; inputs showPts: Boolean, pxWidth: Int32, pxHeight: Int32, samplePlanes: list of Plane, breps: list of Brep, thetaCrop: Double
# ---------- c_script: C# ----------
    DataTree<int> hCounts = new DataTree<int>();
    DataTree<object> hPts = new DataTree<object>();
    DataTree<object> hDists = new DataTree<object>();
    DataTree<object> hNDists = new DataTree<object>();
    Interval dom = new Interval(Double.MinValue, Double.MaxValue);

    Interval ivalPhi = new Interval(0, 2.0 * Math.PI);
    Interval ivalTheta = new Interval(thetaCrop, Math.PI - thetaCrop);

    for (int p = 0; p < samplePlanes.Count; p++){
      Plane samplePlane = samplePlanes[p];

      for (int xi = pxWidth; xi > 0; xi--){
        for (int yi = 0; yi < pxHeight; yi++){
          Double phi = ivalPhi.ParameterAt((Double) xi / (Double) (pxWidth - 1));
          Double theta = ivalTheta.ParameterAt((Double) yi / (Double) (pxHeight - 1));

          Point3d xpt = new Point3d();
          Double xt = Double.MaxValue;

          Double radius = 1.0;
          Double x = radius * Math.Sin(theta) * Math.Cos(phi);
          Double y = radius * Math.Sin(theta) * Math.Sin(phi);
          Double z = radius * Math.Cos(theta);

          Point3d plnPt = samplePlane.PointAt(x, y, z);
          Vector3d rayVec = plnPt - samplePlane.Origin;
          Ray3d ray = new Ray3d(plnPt, rayVec);
          Line seg = new Line(samplePlane.Origin, samplePlane.PointAt(x, y, z));

          var points = Rhino.Geometry.Intersect.Intersection.ProjectPointsToBreps(
            breps,
            new List<Point3d> {samplePlane.Origin},
            ray.Direction,
            doc.ModelAbsoluteTolerance
            );

          int validHits = 0;
          foreach (Point3d pt in points){
            Double t = seg.ClosestParameter(pt);
            if ((t >= 0) && (t < xt)){
              xt = t;
              xpt = pt;
            }

            if (t >= 0) validHits++;
          }

          if (xt < Double.MaxValue){
            hCounts.Add(validHits, new GH_Path(p));
            if (showPts) hPts.Add(xpt, new GH_Path(p));
            //hTs.Add(x, new GH_Path(p)t);
            Double dist = xt * seg.Length;
            hDists.Add(dist, new GH_Path(p));
            
            Double normDist = hitDomain.NormalizedParameterAt(dist);
            if (normDist > 1.0) normDist = 1.0;
            hNDists.Add(normDist, new GH_Path(p));

            if ((dom.Min == Double.MinValue ) || (dist < dom.Min)) dom.T0 = dist;
            if ((dom.Max == Double.MaxValue ) || (dist > dom.Max)) dom.T1 = dist;

          } else {
            hCounts.Add(0, new GH_Path(p));
            if (showPts) hPts.Add(null, new GH_Path(p));
            hDists.Add(null, new GH_Path(p));
            hNDists.Add(null, new GH_Path(p));
          }



        }
      }

      hitCounts = hCounts;
      if (showPts) hitPts = hPts;
      hitNormDists = hNDists;
      hitDists = hDists;
    }
# ---------- end c_script ----------
c_script_2 = CSharpScript(
    thetaCrop=theta_crop_3,
    pxWidth=px_width_6,
    pxHeight=px_height_6,
    samplePlanes=sample_planes,
    hitDomain=hit_domain_3,
    radius=sphere_radius_in_meters)  # -> out, A, B; inputs thetaCrop: Double, pxWidth: Int32, pxHeight: Int32, samplePlanes: list of Plane, radius: Double
# ---------- c_script_2: C# ----------
    Double nudge = RhinoDocument.ModelAbsoluteTolerance;
    Interval ivalPhi = new Interval(nudge, 2.0 * Math.PI - nudge);
    Interval ivalTheta = new Interval(thetaCrop, Math.PI - thetaCrop);
    List<Brep> retBreps = new List<Brep>();
    List<Curve> retCrvs = new List<Curve>();
    List<Circle> retCircs = new List<Circle>();

    for (int p = 0; p < samplePlanes.Count; p++){
      Plane samplePlane = samplePlanes[p];
      List<Curve> crvs = new List<Curve>();
      for (int xi = 0; xi < pxWidth; xi++){
        List<Point3d> pts = new List<Point3d>();
        for (int yi = 0; yi < pxHeight; yi++){
          Double phi = ivalPhi.ParameterAt((Double) xi / (Double) (pxWidth - 1));
          Double theta = ivalTheta.ParameterAt((Double) yi / (Double) (pxHeight - 1));

          Double x = radius * Math.Sin(theta) * Math.Cos(phi);
          Double y = radius * Math.Sin(theta) * Math.Sin(phi);
          Double z = radius * Math.Cos(theta);

          Point3d pt = samplePlane.PointAt(x, y, z);
          pts.Add(pt);


        }

        Curve cv = Curve.CreateInterpolatedCurve(pts, 3);
        crvs.Add(cv);
        retCrvs.Add(cv);
      }

      Brep[] breps = Brep.CreateFromLoft(crvs, Point3d.Unset, Point3d.Unset, LoftType.Normal, true);
      retBreps.Add(breps[0]);
      
      Circle circIn = new Rhino.Geometry.Circle(samplePlane.Origin, hitDomain.T0);
      Circle circOut = new Rhino.Geometry.Circle(samplePlane.Origin, hitDomain.T1);
      retCircs.Add(circIn);
      retCircs.Add(circOut);
    }

    A = retBreps;
    B = retCircs;
# ---------- end c_script_2 ----------
px_height_7 = Integer(px_height_3)
px_width_7 = Integer(px_width_3)
sqrt = SquareRoot(Value=c_script.hitNormDists)
bnd = Bounds(Numbers=c_script.hitDists)
nullrep = ReplaceNulls(Items=sqrt, Replacements="1.0")  # -> Items, Count
gradient = Gradient(LowerLimit=0, UpperLimit=1, Parameter=nullrep.Items, stops=[0: RGB(0, 0, 0), 1: RGB(255, 255, 255)])
c_script_3 = CSharpScript(pxColors=gradient, pxWidth=px_width_7, pxHeight=px_height_7)  # -> out, A; inputs pxColors: list of Color, pxWidth: Int32, pxHeight: Int32
# ---------- c_script_3: C# ----------
    if (pxColors.Count != pxWidth * pxHeight) {
      String msg = "Pixel dimension does not match number of colors provided!";
      Print(msg);
      Component.AddRuntimeMessage(GH_RuntimeMessageLevel.Error, msg);
      //GrasshopperDocument.RequestAbortSolution();
      return;
    }

    System.Drawing.Bitmap img = new Bitmap(pxWidth, pxHeight);
    
    for (var i = 0; i < pxColors.Count; i++) {
      int y = i % pxHeight;
      int x = i / pxHeight;
      //Print(String.Format("{0},{1}", x.ToString(), y.ToString()));
      img.SetPixel(x, y, pxColors[i]);
    }

    A = img;
# ---------- end c_script_3 ----------
panel = Panel(c_script_3.out)

# ----
# WHY ARE PENG'S IMAGES FLIPPED?
flip_image = CSharpScript(doIt=Toggle(True), img=c_script_3.A)  # -> out, A; inputs doIt: Boolean
# ---------- flip_image: C# ----------
 Bitmap bmp = (Bitmap) img;
    if (doIt){
     
      bmp.RotateFlip(RotateFlipType.RotateNoneFlipY);
    }
    A = bmp;
# ---------- end flip_image ----------

image = Data(flip_image.A)
image_2 = Data(image)
c_script_4 = CSharpScript(doIt=Toggle(True), img=image_2)  # -> out, A, B; inputs doIt: Boolean
# ---------- c_script_4: C# ----------
    //Stream imgStream = ImageToBase64((Bitmap) img, System.Drawing.Imaging.ImageFormat.Png);

    Bitmap bmp = (Bitmap) img;
    bmp.Save(@"C:\Users\ksteinfe\Desktop\TEMP\test.png", System.Drawing.Imaging.ImageFormat.Png);


    if (doIt){
      string docid = "45aa73f7-6ad9-42f3-889e-a1d7dbe9946f";
      System.Net.WebRequest request = LobeCreateImageRequest(docid, bmp);
      if (request != null){
        A = LobeGetSimplePrediction(request);
        B = ImageToBase64(bmp);
      }
    }
# ---------- c_script_4: C# additional code ----------
  public string ImageToBase64(System.Drawing.Image image)
  {

    string base64String = null;
    using(MemoryStream m = new MemoryStream())
    {
      image.Save(m, System.Drawing.Imaging.ImageFormat.Png);
      byte[] imageBytes = m.ToArray();
      base64String = Convert.ToBase64String(imageBytes);
      return base64String;
    }

  }

  public Stream ToStream(Image image, System.Drawing.Imaging.ImageFormat format) {
    var stream = new System.IO.MemoryStream();
    image.Save(stream, format);
    stream.Position = 0;
    return stream;
  }


  String LobeGetSimplePrediction(System.Net.WebRequest request){

    try
    {
      using (var response = request.GetResponse())
      {
        using (var stream = response.GetResponseStream())
        {
          var reader = new StreamReader(stream, System.Text.Encoding.UTF8);
          String jsonResponse = reader.ReadToEnd();

          // TODO: this is SUPER kludgey and fragile
          //

          //Print( jsonResponse.Split(new Char[] {':','}','{','"'})[0]  );
          String label = jsonResponse.Split(new Char[] {':'})[1];
          return label.Substring(2, label.Count() - 4);


        }
      }
    }
    catch (System.Net.WebException e)
    {
      Print("WebException");
      Print(e.Message);
      return null;
    }

  }


  System.Net.WebRequest LobeCreateImageRequest(string docid, Bitmap img){
    try
    {
      string baseURL = @"http://api.lobe.ai/predict";
      System.Net.WebRequest request = System.Net.WebRequest.Create(baseURL + "?docid=" + docid);
      request.Method = "POST";
      request.ContentType = "application/json";
      //request.Timeout = 10000;

      String imagestr = "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";
      //imagestr = " ";
      //string imagestr = Convert.ToBase64String(File.ReadAllBytes(imgpath));


      imagestr = ImageToBase64(img);

      using(var streamWriter = new StreamWriter(request.GetRequestStream()))
      {
        string json = @"{
          ""inputs"":{
          ""image"":""" + imagestr +@"""
          }
          }";

        streamWriter.Write(json);
        streamWriter.Flush();
        streamWriter.Close();
      }
      //Print(request.Headers.ToString());
      return request;
    }
    catch (System.Net.WebException e)
    {
      Print("LobeCreateImageRequest WebException");
      Print(e.Message);
      return null;
    }
  }
# ---------- end c_script_4 ----------
panel_2 = Panel(c_script_4.A)
panel_3 = Panel(c_script_4.out)
panel_4 = Panel(c_script_4.B)

# ==== cluster Cluster
bounds = ClusterInput()
breps = ClusterInput()
breps_2 = Brep(breps)
bounds_2 = Curve(bounds)
boundary = BoundarySurfaces(Edges=bounds_2)
merge = Merge(Data1=boundary, Data2=breps_2)
bbox = BoundingBox(Content=merge, Plane=PlaneXY(0, 0, 0), UnionBox=True)  # -> Box, Box_2
debox = DeconstructBox(Box=bbox.Box)  # -> Plane, X, Y, Z
dedomain = DeconstructDomain(Domain=debox.X)  # -> Start, End
dedomain_2 = DeconstructDomain(Domain=debox.Y)  # -> Start, End
avr = Average(Input=[dedomain.Start, dedomain.End])
subtraction = Subtraction(A=dedomain.End, B=dedomain.Start)
avr_2 = Average(Input=[dedomain_2.Start, dedomain_2.End])
subtraction_2 = Subtraction(A=dedomain_2.End, B=dedomain_2.Start)
multiplication = Multiplication(A=subtraction, B="1000")
multiplication_2 = Multiplication(A=subtraction_2, B="1000")
pt = ConstructPoint(XCoordinate=avr, YCoordinate=avr_2, ZCoordinate=expr("-x", "1"))
max = Maximum(A=subtraction, B=subtraction_2)
max_dim = Number(max)
box = CenterBox(Base=pt, X=multiplication, Y=multiplication_2, Z="1")
ground = Box(box)
max_dim_2 = ClusterOutput(max_dim)
ground_2 = ClusterOutput(ground)
