# Grasshopper definition 180321 view capture template.gh (Grasshopper 0.9.76)

number_slider = Slider(0.336, range=0..1)
filename = Panel("cap_{0}.png")
saved_view_name = Panel("CAP")
pop2d = Populate2D(Region={Plane=PlaneXY(0, 0, 0), Size=Domain2(u=0..20, v=0..10)}, Count=100, Seed=1)
# Make sure this object is
#  on top of all other objects
c_script = CSharpScript(Dir="C:\Users\ksteinfe\Desktop\TEMP", Name=filename, VP=saved_view_name, Capture=Toggle(True), Trigger=number_slider)  # -> out, A; inputs Dir: String, Name: String, VP: String, Capture: Boolean
# ---------- c_script: C# ----------
    if (!Capture) return;
    if (string.IsNullOrWhiteSpace(Dir)) return;
    if (string.IsNullOrWhiteSpace(Name)) return;

    // Make sure the directory ends with a \
    if (!Dir.EndsWith(System.IO.Path.DirectorySeparatorChar.ToString()))
      Dir += System.IO.Path.DirectorySeparatorChar;

    // Do not create directories, only use existing ones.
    if (!System.IO.Directory.Exists(Dir))
      return;

    // Assume index=0 for the first filename.
    string fileName = Dir + string.Format(Name, 0);

    // Try to increment the index until we find a name which doesn't exist yet.
    if (System.IO.File.Exists(fileName))
      for (int i = 1; i < int.MaxValue; i++)
      {
        string localName = Dir + string.Format(Name, i);
        if (localName == fileName)
          return;

        if (!System.IO.File.Exists(localName))
        {
          fileName = localName;
          break;
        }
      }


    Rhino.Display.RhinoView view = RhinoDocument.Views.Find(VP, false);
    Bitmap image = view.CaptureToBitmap(false, false, false);
    A = image.Width;
    image.Save(fileName);
    image.Dispose();

    A = fileName;
# ---------- end c_script ----------
cir = Circle(Plane=pop2d, Radius=number_slider)
