# Grasshopper definition 20180225_houses.gh (Grasshopper 1.0.4)

# SPATIAL CONTROLS
list = ValueList({"NONE": 0, "1 Italianate": 1, "2 Queen Anne": 2, "3 Edwardian": 3, "4 Craftsman": 4, "5 Midcentury Modern": 5, "6 Postmodern": 6}, selected="1 Italianate")
origin_pt = Point(Point(0, 0, 0))
random_feature_seed = Number(Slider(4, range=0..10))
x_width = Number(Slider(25, range=20..50))
y_length = Number(Slider(20, range=20..50))
story_height = Number(Slider(10, range=8..12))
stories = Number(Slider(3, range=1..4))
space_type_idx = Integer(list)
story_height_2 = Number(story_height)

# ---- group: Facade Breakdown
Y = UnitY(Factor=y_length)
X = UnitX(Factor=x_width)
ln = Line(StartPoint=origin_pt, EndPoint=X)
panel = Panel("5")
len = Length(Curve=ln)
integer_division = IntegerDivision(A=len, B=panel)
divide = DivideCurve(Curve=ln, Count=integer_division, Kinks=False)  # -> Points, Tangents, Parameters
shift = ShiftList(List=divide.Points, Shift=1, Wrap=True)

# ----
stories_2 = Number(stories)
ln_2 = Line(StartPoint=origin_pt, EndPoint=Y)
len_2 = Length(Curve=ln_2)
integer_division_2 = IntegerDivision(A=len_2, B=panel)
divide_2 = DivideCurve(Curve=ln_2, Count=integer_division_2, Kinks=False)  # -> Points, Tangents, Parameters
shift_2 = ShiftList(List=divide_2.Points, Shift=1, Wrap=True)
ln_3 = Line(StartPoint=shift_2, EndPoint=divide_2.Points)
cull_i = CullIndex(List=ln_3, Indices="-1", Wrap=True)

# ---- group: Floor and Roof Lines
ln_4 = Line(StartPoint=shift, EndPoint=divide.Points)
larger = LargerThan(FirstNumber=stories_2, SecondNumber="1")  # -> LargerThan, OrEqualTo
cull_i_2 = CullIndex(List=ln_4, Indices="-1", Wrap=True)
multiplication = Multiplication(A=story_height_2, B=stories_2)
multiplication_2 = Multiplication(A=stories_2, B=larger.LargerThan)
Z = UnitZ(Factor=story_height_2)
Z_2 = UnitZ(Factor=multiplication)
arrlinear = LinearArray(Geometry=[cull_i_2, cull_i], Direction=Z, Count=multiplication_2)  # -> Geometry, Transform
move = Move(Geometry=[cull_i_2, cull_i], Motion=Z_2)  # -> Geometry, Transform

# ----
lines_for_1st_level = Line(flatten([cull_i_2, cull_i]))
lines_for_upper_stories = Line(arrlinear.Geometry)
lines_for_roof = Line(move.Geometry)
roof_points = Point([divide.Points, divide_2.Points])
addition = Addition(A=Z_2, B="{0,0,-1.5}")
Z_3 = UnitZ(Factor=story_height_2)
Z_4 = UnitZ(Factor=story_height_2)
join = JoinCurves(Curves=lines_for_roof, Preserve=False)
cull_i_3 = CullIndex(List=lines_for_upper_stories, Indices="0", Wrap=True)
extr = Extrude(Base=lines_for_1st_level, Direction=Z_3)
extr_2 = Extrude(Base=cull_i_3, Direction=Z_4)
move_2 = Move(Geometry=divide.Points, Motion=addition)  # -> Geometry, Transform
move_3 = Move(Geometry=divide_2.Points, Motion=addition)  # -> Geometry, Transform
offset = OffsetCurve(Curve=join, Distance="-2", Plane=PlaneXY(0, 0, 0), Corners=1)
lng = ListLength(List=extr)  # -> expr("x-1", Length)
explode = Explode(Curve=offset, Recursive=True)  # -> Segments, Vertices
random = Random(Range=lng, Number=1, Seed=random_feature_seed)
item = ListItem(List=explode.Segments, Index=0, Wrap=True)
item_2 = ListItem(List=explode.Segments, Index=1, Wrap=True)
group = Group(Objects=flatten([extr, extr_2]))
round = Round(Number=random)  # -> Nearest, Floor, Ceiling
item_3 = ListItem(List=lines_for_1st_level, Index=round.Nearest, Wrap=True)
pull = PullPoint(Point=move_2.Geometry, Geometry=item, ClosestOnly=True)  # -> ClosestPoint, Distance
pull_2 = PullPoint(Point=move_3.Geometry, Geometry=item_2, ClosestOnly=True)  # -> ClosestPoint, Distance
Z_5 = UnitZ(Factor=1)
step_line = Curve(item_3)
bbox = BoundingBox(Content=group, Plane=PlaneXY(0, 0, 0))  # -> Box, Box_2
cull_i_4 = CullIndex(List=extr, Indices=round.Nearest, Wrap=True)
item_4 = ListItem(List=extr, Index=round.Nearest, Wrap=True)
arc = ArcSED(Start=move_3.Geometry, End=pull_2.ClosestPoint, Direction=Z_5)  # -> Arc, Plane, Radius
arc_2 = ArcSED(Start=move_2.Geometry, End=pull.ClosestPoint, Direction=Z_5)  # -> Arc, Plane, Radius

# ---- group: Make Windows
windows = Surface([cull_i_4, extr_2])
pcen = PolygonCenter(Polyline=windows)  # -> CenterV, CenterE, CenterA
scale_nu = ScaleNU(Geometry=windows, Plane=pcen.CenterV, ScaleX="0.6", ScaleY="0.6", ScaleZ="0.65")  # -> Geometry, Transform
deplane = DeconstructPlane(Plane=scale_nu.Geometry)  # -> Origin, XAxis, YAxis, expr("x*0.5", ZAxis)
abs = Absolute(Value=deplane.ZAxis)
extr_3 = Extrude(Base=scale_nu.Geometry, Direction=abs)

# ---- group: Make Doorway
doorway = Surface(item_4)
pcen_2 = PolygonCenter(Polyline=doorway)  # -> CenterV, CenterE, CenterA
panel_2 = Panel("0.8")
scale_nu_2 = ScaleNU(Geometry=doorway, Plane=pcen_2.CenterV, ScaleX="0.6", ScaleY="0.6", ScaleZ=panel_2)  # -> Geometry, Transform
scale_nu_3 = ScaleNU(Geometry=step_line, Plane=pcen_2.CenterV, ScaleX="0.6", ScaleY="0.6", ScaleZ=1)  # -> Geometry, Transform
deplane_2 = DeconstructPlane(Plane=scale_nu_2.Geometry)  # -> Origin, XAxis, YAxis, expr("x*0.5", ZAxis)
abs_2 = Absolute(Value=deplane_2.ZAxis)
extr_4 = Extrude(Base=scale_nu_2.Geometry, Direction=abs_2)

# ---- group: Make Stairs
expression = Expression(x=story_height_2, y=panel_2, Expression="(x*(1-y)/2)/3")
extr_5 = Extrude(Base=scale_nu_3.Geometry, Direction=expr("-x", abs_2))
arrlinear_2 = LinearArray(Geometry=extr_5, Direction=expr("-x", abs_2), Count="3")  # -> Geometry, Transform
series = Series(Start=expression, Step=expression, Count="3")
Z_6 = UnitZ(Factor=series)
extr_6 = Extrude(Base=arrlinear_2.Geometry, Direction=reverse(Z_6))

# ----
sdiff = SolidDifference(BrepsA=bbox.Box, BrepsB=flatten([extr_4, extr_3]))
sunion = SolidUnion(Breps=[extr_6, sdiff])
_1_italianate = Brep(flatten(sunion))
_4_craftsman = Brep()
_0_nothing = Geometry()
_2_queen_anne = Brep()
_3_edwardian = Brep()
_5_midcentury_modern = Brep()
_6_post_modern = Brep()
space_type_idx_2 = Integer(space_type_idx)
filter = StreamFilter(
    Gate=space_type_idx_2,
    Stream0=_0_nothing,
    Stream1=_1_italianate,
    Stream2=_2_queen_anne,
    Stream3=_3_edwardian,
    Stream4=_4_craftsman,
    Stream5=_5_midcentury_modern,
    Stream6=_6_post_modern)
context = Brep(filter)
