# Grasshopper definition isovist trainer.gh (Grasshopper 1.0.4)

save_path = FilePath("C:\Users\ksteinfe\Desktop\TEMP\")

# ---- group: calculate hits
# Calculates hit distances. Nothing else can happen if not calculated.
toggle = BooleanToggle(True)
button = Button()
do_calc_hits = Boolean(toggle)

# ---- group: save files
# Saves image files. Can only happen if hits are calculated.
toggle_2 = BooleanToggle(True)
do_save_files = Boolean(toggle_2)

# ----
hit_domain = Domain()
theta_crop = Number()
px_width = Integer()
px_height = Integer()

# ---- group: debug
save_small_tiles = Boolean(Toggle(False))
visualize_rays = Boolean(Toggle(False))
save_big_tiled = Boolean(Toggle(True))

# ----
bounds_of_possible_positions = Curve()
context = Brep([<brep referenced from the Rhino model> x287])
context_2 = Brep(context)
out_bnds = Curve()
production_sample_count = Integer()

# ---- group: define ground
# DEFINE GROUND: The ground is defined at the lower edge of the bounding box of the given Breps. Ground box is sized to 1000 times the size of the bounding box. Maximum x-y dimension of bounding box is returned.
cluster = Cluster(bounds=out_bnds, breps=context_2)  # -> ground_2, max_dim_2

# ----
boundary = BoundarySurfaces(Edges=bounds_of_possible_positions)
seed = Number()
popgeo = PopulateGeometry(Geometry=boundary, Count=production_sample_count, Seed=seed)
merge = Merge(Data1=cluster.ground_2, Data2=context_2)
cluster_2 = Cluster_2(bnd_crv=bounds_of_possible_positions, pt2d=popgeo)
breps = Brep(merge)
breps_2 = Brep(breps)
do_calc_hits_2 = Boolean(do_calc_hits)
do_save_files_2 = Boolean(do_save_files)
context_3 = Brep(context)
filter = StreamFilter(Gate=do_calc_hits_2, Stream1=cluster_2)
c_script = CSharpScript(nudge=context_3, doIt=do_save_files_2)  # -> out, A, B; inputs nudge: list, doIt: Boolean
# ---------- c_script: C# ----------
    if (!doIt) return;
    
    if (RhinoDocument.IsOpening){
      Print("document is opening");
      Component.ExpireSolution(true);
      return;
    }



    Print(RhinoDocument.Path.ToString());

    String label = System.IO.Directory.GetParent(RhinoDocument.Path).Name;
    if (label.Contains('-')) label = label.Split('-')[label.Split('-').Count() - 1].Trim();

    String filename = Path.GetFileNameWithoutExtension(RhinoDocument.Path);


    A = label + "-" + filename;
    B = label;
# ---------- end c_script ----------
sample_planes = Plane(filter)
sample_planes_2 = Plane(sample_planes)
c_script_2 = CSharpScript(
    showPts=Toggle(False),
    pxWidth=px_width,
    pxHeight=px_height,
    samplePlanes=sample_planes_2,
    breps=breps_2,
    hitDomain=hit_domain,
    thetaCrop=theta_crop)  # -> out, hitCounts, hitPts, hitDists, hitNormDists, A; inputs showPts: Boolean, pxWidth: Int32, pxHeight: Int32, samplePlanes: list of Plane, breps: list of Brep, thetaCrop: Double
# ---------- c_script_2: C# ----------
    DataTree<int> hCounts = new DataTree<int>();
    DataTree<object> hPts = new DataTree<object>();
    DataTree<object> hDists = new DataTree<object>();
    DataTree<object> hNDists = new DataTree<object>();
    Interval dom = new Interval(Double.MinValue, Double.MaxValue);

    Interval ivalPhi = new Interval(0, 2.0 * Math.PI);
    Interval ivalTheta = new Interval(thetaCrop, Math.PI - thetaCrop);

    for (int p = 0; p < samplePlanes.Count; p++){
      Plane samplePlane = samplePlanes[p];

      for (int xi = pxWidth; xi > 0; xi--){
        for (int yi = 0; yi < pxHeight; yi++){
          Double phi = ivalPhi.ParameterAt((Double) xi / (Double) (pxWidth - 1));
          Double theta = ivalTheta.ParameterAt((Double) yi / (Double) (pxHeight - 1));

          Point3d xpt = new Point3d();
          Double xt = Double.MaxValue;

          Double radius = 1.0;
          Double x = radius * Math.Sin(theta) * Math.Cos(phi);
          Double y = radius * Math.Sin(theta) * Math.Sin(phi);
          Double z = radius * Math.Cos(theta);

          Point3d plnPt = samplePlane.PointAt(x, y, z);
          Vector3d rayVec = plnPt - samplePlane.Origin;
          Ray3d ray = new Ray3d(plnPt, rayVec);
          Line seg = new Line(samplePlane.Origin, samplePlane.PointAt(x, y, z));

          var points = Rhino.Geometry.Intersect.Intersection.ProjectPointsToBreps(
            breps,
            new List<Point3d> {samplePlane.Origin},
            ray.Direction,
            doc.ModelAbsoluteTolerance
            );

          int validHits = 0;
          foreach (Point3d pt in points){
            Double t = seg.ClosestParameter(pt);
            if ((t >= 0) && (t < xt)){
              xt = t;
              xpt = pt;
            }

            if (t >= 0) validHits++;
          }

          if (xt < Double.MaxValue){
            hCounts.Add(validHits, new GH_Path(p));
            if (showPts) hPts.Add(xpt, new GH_Path(p));
            //hTs.Add(x, new GH_Path(p)t);
            Double dist = xt * seg.Length;
            hDists.Add(dist, new GH_Path(p));
            
            Double normDist = hitDomain.NormalizedParameterAt(dist);
            if (normDist > 1.0) normDist = 1.0;
            hNDists.Add(normDist, new GH_Path(p));

            if ((dom.Min == Double.MinValue ) || (dist < dom.Min)) dom.T0 = dist;
            if ((dom.Max == Double.MaxValue ) || (dist > dom.Max)) dom.T1 = dist;

          } else {
            hCounts.Add(0, new GH_Path(p));
            if (showPts) hPts.Add(null, new GH_Path(p));
            hDists.Add(null, new GH_Path(p));
            hNDists.Add(null, new GH_Path(p));
          }



        }
      }

      hitCounts = hCounts;
      if (showPts) hitPts = hPts;
      hitNormDists = hNDists;
      hitDists = hDists;
    }
# ---------- end c_script_2 ----------
sqrt = SquareRoot(Value=c_script_2.hitNormDists)
bnd = Bounds(Numbers=c_script_2.hitDists)
nullrep = ReplaceNulls(Items=sqrt, Replacements="1.0")  # -> Items, Count
panel = Panel(bnd)
gradient = Gradient(LowerLimit=0, UpperLimit=1, Parameter=nullrep.Items, stops=[0: RGB(255, 255, 255), 1: RGB(0, 0, 0)])
panel_2 = Panel(nullrep.Items)
tstat = TreeStatistics(Tree=simplify(gradient))  # -> Paths, Length, Count
filename_prefix = Text(c_script.A)
series = Series(Start=0, Step=1, Count=tstat.Count)
expression = Expression(x=series, y=filename_prefix, Expression="Format(\"{1}-{0:0000}\", x, y)")
do_save_images = Boolean()
save_path_2 = FilePath("C:\Users\ksteinfe\Desktop\")
txt = Text(graft(expression))
px_height_2 = Integer()
px_width_2 = Integer()
c_script_3 = CSharpScript(doSave=do_save_images, savepath=save_path_2, filename=txt, pxColors=gradient, pxWidth=px_width_2, pxHeight=px_height_2)  # -> out, A; inputs doSave: Boolean, savepath: String, filename: String, pxColors: list of Color, pxWidth: Int32, pxHeight: Int32
# ---------- c_script_3: C# ----------
    if (!doSave) return;

    if (pxColors.Count != pxWidth * pxHeight) {
      String msg = "Pixel dimension does not match number of colors provided!";
      Print(msg);
      Component.AddRuntimeMessage(GH_RuntimeMessageLevel.Error, msg);
      //GrasshopperDocument.RequestAbortSolution();
      return;
    }

    System.Drawing.Bitmap img = new Bitmap(pxWidth, pxHeight);

    for (var i = 0; i < pxColors.Count; i++) {
      int y = i % pxHeight;
      int x = i / pxHeight;
      //Print(String.Format("{0},{1}", x.ToString(), y.ToString()));
      img.SetPixel(x, y, pxColors[i]);
    }
    img.Save(savepath + filename + ".png", System.Drawing.Imaging.ImageFormat.Png);
    Print(savepath + filename + ".png");

    A = img;
# ---------- end c_script_3 ----------
panel_3 = Panel(c_script_3.out)

# ==== cluster Cluster
bounds = ClusterInput()
breps = ClusterInput()
breps_2 = Brep(breps)
bounds_2 = Curve(bounds)
boundary = BoundarySurfaces(Edges=bounds_2)
merge = Merge(Data1=boundary, Data2=breps_2)
bbox = BoundingBox(Content=merge, Plane=PlaneXY(0, 0, 0), UnionBox=True)  # -> Box, Box_2
debox = DeconstructBox(Box=bbox.Box)  # -> Plane, X, Y, Z
dedomain = DeconstructDomain(Domain=debox.X)  # -> Start, End
dedomain_2 = DeconstructDomain(Domain=debox.Y)  # -> Start, End
avr = Average(Input=[dedomain.Start, dedomain.End])
subtraction = Subtraction(A=dedomain.End, B=dedomain.Start)
avr_2 = Average(Input=[dedomain_2.Start, dedomain_2.End])
subtraction_2 = Subtraction(A=dedomain_2.End, B=dedomain_2.Start)
multiplication = Multiplication(A=subtraction, B="1000")
multiplication_2 = Multiplication(A=subtraction_2, B="1000")
pt = ConstructPoint(XCoordinate=avr, YCoordinate=avr_2, ZCoordinate=expr("-x", "1"))
max = Maximum(A=subtraction, B=subtraction_2)
max_dim = Number(max)
box = CenterBox(Base=pt, X=multiplication, Y=multiplication_2, Z="1")
ground = Box(box)
max_dim_2 = ClusterOutput(max_dim)
ground_2 = ClusterOutput(ground)

# ==== cluster Cluster_2
bnd_crv = ClusterInput()
eye_height = ClusterInput()
pt2d = ClusterInput()
bnd_crv_2 = Curve(bnd_crv)
eye_height_2 = Number(eye_height)
pt2d_2 = Point(pt2d)
area = Area(Geometry=bnd_crv_2)  # -> Area, Centroid
Z = UnitZ(Factor=eye_height_2)
move = Move(Geometry=pt2d_2, Motion=Z)  # -> Geometry, Transform
vec2pt = Vector2Pt(PointA=pt2d_2, PointB=area.Centroid, Unitize=False)  # -> Vector, Length
Z_2 = UnitZ(Factor=1)
rev = Reverse(Vector=vec2pt.Vector)
xprod = CrossProduct(VectorA=rev, VectorB=Z_2, Unitize=False)  # -> Vector, Length
rev_2 = Reverse(Vector=xprod.Vector)
pl = ConstructPlane(Origin=move.Geometry, XAxis=rev, YAxis=rev_2)
plns = Plane(pl)
plns_2 = ClusterOutput(plns)
